test file "regTests"
  setup callback:
    control_data;

suite "Baseline Tests"

  case "Desktop - Simscape Converter" [baseline]
    model m01_PMSM_Desktop
    post-load callback:
      set_param([sltest_sut,'/Inverter'],'LabelModeActiveChoice','SimscapeConv');
    baseline "baseline_desktop.mat": rel tol 0.01, leading tol 0.001, lagging tol 0.001
      g
      iabc
      spd
      trq

suite "Back-to-Back Tests"

  case "Simcape Converters vs Switches" [equivalence]
    simulation 1:
      model m01_PMSM_Desktop
      post-load callback:
        set_param([sltest_sut,'/Inverter'],'LabelModeActiveChoice','SimscapeConv');
    simulation 2:
      model m01_PMSM_Desktop
      post-load callback:
        set_param([sltest_sut,'/Inverter'],'LabelModeActiveChoice','SimscapeSw');
    equivalence criteria
      trq(1)
      spd(1)
      g(1)
      iabc(1)
      trq(2)
      spd(2)
      g(2)
      g(3)
      g(4)
      g(5)
      g(6)
      iabc(2)
      iabc(3)

  case "Simscape Switches vs Pejovic" [equivalence]
    simulation 1:
      model m01_PMSM_Desktop
      post-load callback:
        set_param([sltest_sut,'/Inverter'],'LabelModeActiveChoice','SimscapeSw');
    simulation 2:
      model m01_PMSM_Desktop
      post-load callback:
        set_param([sltest_sut,'/Inverter'],'LabelModeActiveChoice','Pejovic');
    equivalence criteria
      trq(1): abs tol 1, rel tol 0.01, leading tol 0.001, lagging tol 0.001
      spd(1): abs tol 0.001, rel tol 0.01, leading tol 0.001, lagging tol 0.001
      iabc(1): abs tol 1, rel tol 0.01, leading tol 0.01, lagging tol 0.01
      trq(2): abs tol 1, rel tol 0.01, leading tol 0.001, lagging tol 0.001
      spd(2): abs tol 0.001, rel tol 0.01, leading tol 0.001, lagging tol 0.001
      iabc(2): abs tol 1, rel tol 0.01, leading tol 0.01, lagging tol 0.01
      iabc(3): abs tol 1, rel tol 0.01, leading tol 0.01, lagging tol 0.01

  case "Pejovic vs State-Space Pejovic" [equivalence]
    simulation 1:
      model m01_PMSM_Desktop
      pre-load callback:
        Ts=2.5e-06;
        avgFactor=1;
      post-load callback:
        set_param([sltest_sut,'/Inverter'],'LabelModeActiveChoice','Pejovic');
    simulation 2:
      model m02_PMSM_HDL
      pre-load callback:
        Ts=2.5e-06;
        avgFactor=1;
    equivalence criteria
      trq(1): abs tol 1, rel tol 0.01, leading tol 0.001, lagging tol 0.001
      spd(1): abs tol 0.01, rel tol 0.01, leading tol 0.001, lagging tol 0.001
      iabc(1): abs tol 1, rel tol 0.01, leading tol 0.01, lagging tol 0.01
      trq(2): abs tol 1, rel tol 0.01, leading tol 0.001, lagging tol 0.001
      spd(2): abs tol 0.01, rel tol 0.01, leading tol 0.001, lagging tol 0.001
      iabc(2): abs tol 1, rel tol 0.01, leading tol 0.01, lagging tol 0.01
      iabc(3): abs tol 1, rel tol 0.01, leading tol 0.01, lagging tol 0.01

  case "Pejovic vs Pejovic SCA" [equivalence]
    simulation 1:
      model m01_PMSM_Desktop
      pre-load callback:
        Ts = 2.5e-06;
        avgFactor = 1;
      post-load callback:
        set_param([sltest_sut,'/Inverter'],'LabelModeActiveChoice','Pejovic');
    simulation 2:
      model m01_PMSM_Desktop, mode Accelerator
      pre-load callback:
        Ts = 2.5e-07;
        avgFactor = 10;
      post-load callback:
        set_param([sltest_sut,'/Inverter'],'LabelModeActiveChoice','PejovicSCA');
    equivalence criteria
      trq(1): abs tol 1, rel tol 0.01, leading tol 0.001, lagging tol 0.001
      spd(1): abs tol 0.01, rel tol 0.01, leading tol 0.001, lagging tol 0.001
      iabc(1): abs tol 5, rel tol 0.01, leading tol 0.001, lagging tol 0.001
      trq(2): abs tol 1, rel tol 0.01, leading tol 0.001, lagging tol 0.001
      spd(2): abs tol 0.01, rel tol 0.01, leading tol 0.001, lagging tol 0.001
      iabc(2): abs tol 5, rel tol 0.01, leading tol 0.001, lagging tol 0.001
      iabc(3): abs tol 5, rel tol 0.01, leading tol 0.001, lagging tol 0.001